# Grasshopper definition 1-1.gh (Grasshopper 0.9.76)

# ---- group: 1-1
x方向柱ピッチ_mm = Slider(8000, range=0..20000)
# 1
階高_mm = Slider(4500, range=0..10000)
x方向スパン数 = Slider(3, range=0..10)
y方向柱ピッチ_mm = Slider(7000, range=0..20000)
y方向スパン数 = Slider(3, range=0..10)
階数 = Slider(3, range=0..10)

# ---- group: 1-2
addition = Addition(A=y方向スパン数, B=1)
addition_2 = Addition(A=x方向スパン数, B=1)
series = Series(Start=0, Step=1, Count=addition)
series_2 = Series(Start=0, Step=1, Count=addition_2)
multiplication = Multiplication(A=y方向柱ピッチ_mm, B=series)
multiplication_2 = Multiplication(A=x方向柱ピッチ_mm, B=series_2)

# ----
梁幅_mm = Slider(450, range=0..1000)
梁せい_mm = Slider(900, range=0..1000)

# ---- group: 3-1
# 3
スラブ厚 = Slider(150, range=0..1000)
addition_3 = Addition(A=階数, B=1)
item = ListItem(List=multiplication, Index=y方向スパン数, Wrap=True)
item_2 = ListItem(List=multiplication_2, Index=x方向スパン数, Wrap=True)
series_3 = Series(Start=0, Step=1, Count=addition_3)
planesrf = PlaneSurface(Plane=PlaneXY(0, 0, 0), XSize=item_2, YSize=item)
multiplication_3 = Multiplication(A=階高_mm, B=series_3)
Z = UnitZ(Factor=multiplication_3)
move = Move(Geometry=planesrf, Motion=Z)  # -> Geometry, Transform

# ---- group: 4-1
# 4
# Y方向梁
梁幅_mm_2 = Slider(450, range=0..1000)
梁せい_mm_2 = Slider(900, range=0..2000)

# ---- group: 2-1
# 2
柱サイズ_mm = Slider(800, range=0..1000)
division = Division(A=柱サイズ_mm, B=2)
division_2 = Division(A=柱サイズ_mm, B=-2)
dom = ConstructDomain(DomainStart=division, DomainEnd=division_2)
rectangle = Rectangle(Plane=PlaneXY(0, 0, 0), XSize=dom, YSize=dom, Radius=0)  # -> Rectangle, Length
boxrec = BoxRectangle(Rectangle=rectangle.Rectangle, Height=階高_mm)

# ----
# X方向梁
division_3 = Division(A=梁幅_mm, B=2)
division_4 = Division(A=梁幅_mm, B=-2)
dom_2 = ConstructDomain(DomainStart=division_3, DomainEnd=division_4)
yz = YZPlane(Origin=Point(0, 0, 0))
neg = Negative(Value=梁せい_mm)
series_4 = Series(Start=0, Step=1, Count=x方向スパン数)
series_5 = Series(Start=0, Step=1, Count=addition)
rectangle_2 = Rectangle(Plane=yz, XSize=dom_2, YSize=neg, Radius=0)  # -> Rectangle, Length
multiplication_4 = Multiplication(A=x方向柱ピッチ_mm, B=series_4)
multiplication_5 = Multiplication(A=y方向柱ピッチ_mm, B=series_5)
boxrec_2 = BoxRectangle(Rectangle=rectangle_2.Rectangle, Height=x方向柱ピッチ_mm)
X = UnitX(Factor=multiplication_4)
Y = UnitY(Factor=multiplication_5)
move_2 = Move(Geometry=boxrec_2, Motion=X)  # -> Geometry, Transform
move_3 = Move(Geometry=move_2.Geometry, Motion=graft(Y))  # -> Geometry, Transform

# ---- group: 4-1
xz = XZPlane(Origin=Point(0, 0, 0))
division_5 = Division(A=梁幅_mm_2, B=2)
division_6 = Division(A=梁幅_mm_2, B=-2)
neg_2 = Negative(Value=梁せい_mm_2)
dom_3 = ConstructDomain(DomainStart=division_5, DomainEnd=division_6)
rectangle_3 = Rectangle(Plane=xz, XSize=dom_3, YSize=neg_2, Radius=0)  # -> Rectangle, Length
neg_3 = Negative(Value=y方向柱ピッチ_mm)
boxrec_3 = BoxRectangle(Rectangle=rectangle_3.Rectangle, Height=neg_3)

# ---- group: 4-2
series_6 = Series(Start=0, Step=1, Count=addition_2)
series_7 = Series(Start=0, Step=1, Count=y方向スパン数)
multiplication_6 = Multiplication(A=x方向柱ピッチ_mm, B=series_6)
multiplication_7 = Multiplication(A=y方向柱ピッチ_mm, B=series_7)
X_2 = UnitX(Factor=multiplication_6)
Y_2 = UnitY(Factor=multiplication_7)
move_4 = Move(Geometry=boxrec_3, Motion=X_2)  # -> Geometry, Transform
move_5 = Move(Geometry=move_4.Geometry, Motion=graft(Y_2))  # -> Geometry, Transform

# ---- group: 2-2
X_3 = UnitX(Factor=multiplication_2)
series_8 = Series(Start=0, Step=1, Count=階数)
move_6 = Move(Geometry=boxrec, Motion=X_3)  # -> Geometry, Transform
Y_3 = UnitY(Factor=multiplication)
multiplication_8 = Multiplication(A=階高_mm, B=series_8)
move_7 = Move(Geometry=move_6.Geometry, Motion=graft(Y_3))  # -> Geometry, Transform
Z_2 = UnitZ(Factor=multiplication_8)
move_8 = Move(Geometry=graft(move_7.Geometry), Motion=Z_2)  # -> Geometry, Transform
preview = CustomPreview(Geometry=move_8.Geometry, Shader=ColourSwatch(SwatchColor=RGB(255, 0, 204)))

# ---- group: 3-2
neg_4 = Negative(Value=スラブ厚)
Z_3 = UnitZ(Factor=neg_4)
extr = Extrude(Base=move.Geometry, Direction=Z_3)

# ---- group: 4-3
geo = Geometry([move_5.Geometry, move_3.Geometry])
move_9 = Move(Geometry=graft(geo), Motion=Z)  # -> Geometry, Transform
preview_2 = CustomPreview(Geometry=move_9.Geometry, Shader=ColourSwatch(SwatchColor=RGB(0, 34, 255)))

# ---- group: 5-1
# 5
オフセット長さ_mm = Panel("3000")
文字サイズ = Panel("1000")

# ---- group: 5-2
pt = ConstructPoint(XCoordinate=0, YCoordinate=item, ZCoordinate=0)
pt_2 = Point(Point(0, 0, 0))
pt_3 = ConstructPoint(XCoordinate=item_2, YCoordinate=0, ZCoordinate=0)
neg_5 = Negative(Value=オフセット長さ_mm)
aligndim = AlignedDimension(Plane=PlaneXY(0, 0, 0), PointA=pt_2, PointB=pt_3, Offset=neg_5, Text="{0:0}", Size=文字サイズ)
aligndim_2 = AlignedDimension(Plane=PlaneXY(0, 0, 0), PointA=pt_2, PointB=pt, Offset=オフセット長さ_mm, Text="{0:0}", Size=文字サイズ)
item_3 = ListItem(List=multiplication_3, Index=階数, Wrap=True)
xz_2 = XZPlane(Origin=pt)
pt_4 = ConstructPoint(XCoordinate=0, YCoordinate=item, ZCoordinate=item_3)
aligndim_3 = AlignedDimension(Plane=xz_2, PointA=pt, PointB=pt_4, Offset=オフセット長さ_mm, Text="{0:0}", Size=文字サイズ)
