# Grasshopper definition 1-2.gh (Grasshopper 0.9.76)

# ---- group: 1-1
スパン = Slider(6000, range=0..10000)
奥行 = Slider(150, range=0..1000)
# 1
高さ = Slider(4000, range=0..10000)
分割数 = Slider(20, range=0..30)
角度 = Slider(0, range=0..90)
厚み = Slider(10, range=0..10)

# ---- group: 2-1
# 2
xz = XZPlane(Origin=Point(0, 0, 0))
yz = YZPlane(Origin=Point(0, 0, 0))
planesrf = PlaneSurface(Plane=xz, XSize=スパン, YSize=高さ)
planesrf_2 = PlaneSurface(Plane=yz, XSize=スパン, YSize=高さ)
planesrf_3 = PlaneSurface(Plane=PlaneXY(0, 0, 0), XSize=スパン, YSize=スパン)
Y = UnitY(Factor=スパン)
X = UnitX(Factor=スパン)
Z = UnitZ(Factor=高さ)
move = Move(Geometry=planesrf, Motion=Y)  # -> Geometry, Transform
move_2 = Move(Geometry=planesrf_2, Motion=X)  # -> Geometry, Transform
move_3 = Move(Geometry=planesrf_3, Motion=Z)  # -> Geometry, Transform

# ---- group: 1-2
pt = ConstructPoint(XCoordinate="0", YCoordinate="0", ZCoordinate=高さ)
pt_2 = Point(Point(0, 0, 0))
ln = Line(StartPoint=pt_2, EndPoint=pt)

# ---- group: 1-3
neg = Negative(Value=奥行)
dom = ConstructDomain(DomainStart=neg, DomainEnd="0")
divide = DivideCurve(Curve=ln, Count=分割数, Kinks=False)  # -> Points, Tangents, Parameters
planesrf_4 = PlaneSurface(Plane=divide.Points, XSize=スパン, YSize=dom)
Z_2 = UnitZ(Factor=厚み)
extr = Extrude(Base=planesrf_4, Direction=Z_2)

# ---- group: 1-4
pi = Pi(Factor=1)
division = Division(A=角度, B="180")
X_2 = UnitX(Factor=1)
multiplication = Multiplication(A=division, B=pi)
rot3d = Rotate3D(Geometry=extr, Angle=multiplication, Center=divide.Points, Axis=X_2)  # -> Geometry, Transform
