# Grasshopper definition 1-3.gh (Grasshopper 0.9.76)
# plug-ins: LunchBox

# ---- group: 1-1
# 1
平面サイズ_mm = Slider(6000, range=0..10000)
ランダムシード = Slider(50, range=0..100)
削除数 = Slider(20, range=0..100)

xz = XZPlane(Origin=Point(0, 0, 0))
planesrf = PlaneSurface(Plane=xz, XSize=平面サイズ_mm, YSize=平面サイズ_mm)

# ---- group: 1-2
quads = QuadPanels(Surface=planesrf, UDivisions=10, VDivisions=10)
diamond = DiamondPanels(Surface=planesrf, UDivisions=10, VDivisions=10)  # -> DiamondPanels, TriPanels
tria = TriangularPanelsA(Surface=planesrf, UDivisions=10, VDivisions=10)
trib = TrianglePanelsB(Surface=planesrf, UDivisions=10, VDivisions=10)
tric = TrianglePanelsC(Surface=planesrf, UDivisions=10, VDivisions=10)
hex = HexagonCells(Surface=planesrf, UDivisions=10, VDivisions=10, TParameter=0.25)  # -> HexagonCells, Centers

# ---- group: 1-3
list = ValueList({"Quad": 0, "Diamond": 1, "Triangular A": 2, "Triange B": 3, "Triange C": 4, "Hexagon": 5}, selected="Diamond")
filter = StreamFilter(
    Gate=list,
    Stream0=quads,
    Stream1=[diamond.DiamondPanels, diamond.TriPanels],
    Stream2=tria,
    Stream3=trib,
    Stream4=tric,
    Stream5=hex.HexagonCells)

# ---- group: 1-4
reduce = RandomReduce(List=filter, Reduction=削除数, Seed=ランダムシード)
