# Grasshopper definition 1-4.gh (Grasshopper 0.9.76)
# plug-ins: LunchBox

# ---- group: 1-1
# 1
x座標_mm = Slider(10000, range=0..20000)
トラスせい_mm = Slider(1000, range=0..10000)
分割数 = Slider(10, range=0..10)
トラスタイプ = Slider(0, range=0..3)
半径_mm = Slider(20, range=0..1000)

pt = ConstructPoint(XCoordinate=x座標_mm, YCoordinate=0, ZCoordinate=0)
Z = UnitZ(Factor=トラスせい_mm)
pt_2 = Point(Point(0, 0, 0))
ln = Line(StartPoint=pt_2, EndPoint=pt)
move = Move(Geometry=ln, Motion=Z)  # -> Geometry, Transform

# ---- group: 1-2
truss = _2DTruss(CurveA=ln, CurveB=move.Geometry, Divisions=分割数, TrussToggle=トラスタイプ)  # -> PrimaryLines, BraceLines, VerticalLines, StructureNodes

# ---- group: 1-3
cyl = Cylinder(Base=truss.PrimaryLines, Radius=半径_mm, Length=truss.PrimaryLines)
cyl_2 = Cylinder(Base=truss.BraceLines, Radius=半径_mm, Length=truss.BraceLines)
cyl_3 = Cylinder(Base=truss.VerticalLines, Radius=半径_mm, Length=truss.VerticalLines)
