# Grasshopper definition 1-5.gh (Grasshopper 0.9.76)
# plug-ins: Kangaroo Components

# ---- group: 1-1
荷重 = Slider(10, range=-1..100)
長さ比 = Slider(1, range=0..2)
大きさ = Slider(10, range=0..10000)

rectangle = Rectangle(Plane=PlaneXY(0, 0, 0), XSize=大きさ, YSize=大きさ, Radius=0)  # -> Rectangle, Length
mplane = MeshPlane(Boundary=rectangle.Rectangle, WidthCount=10, HeightCount=10)  # -> Mesh, Area

# ---- group: 1-2
# 1
medges = MeshEdges(Mesh=mplane.Mesh)  # -> NakedEdges, InteriorEdges, NonManifoldEdges
line = Line(flatten([medges.NakedEdges, medges.InteriorEdges]))

# ---- group: 1-3
len = Length(Curve=line)
multiplication = Multiplication(A=len, B=長さ比)
springs = SpringsFromLine(Connection=line, Stiffness=1000, Damping=10, RestLength=multiplication, UpperCutoff=0, LowerCutoff=0, Plasticity=0)

# ---- group: 1-4
demesh = DeconstructMesh(Mesh=mplane.Mesh)  # -> Vertices, Faces, Colours, Normals
Z = UnitZ(Factor=荷重)
uforce = UnaryForce(Point=demesh.Vertices, Force=Z)
merge = Merge(Data1=springs, Data2=uforce)  # -> flatten(Result)

# ---- group: 1-5
meshcorners = MeshCorners(M=mplane.Mesh, A=0.5235987756)

# ---- group: 1-6
timer = Timer(TimerInterval=20, Target=kangaroo)
kangaroo = KangarooPhysics(ForceObjects=merge, AnchorPoints=meshcorners, Settings=null, Geometry=mplane.Mesh, SimulationReset=Button())  # -> Out, Iterations, ParticlesOut, GeometryOut, KE
geo = Geometry(kangaroo.GeometryOut)

# ==== cluster MeshCorners: Finds the corners of the boundary of a mesh
M = ClusterInput()
medges = MeshEdges(Mesh=M)  # -> NakedEdges, InteriorEdges, NonManifoldEdges
join = JoinCurves(Curves=medges.NakedEdges, Preserve=False)
explode = Explode(Curve=join, Recursive=True)  # -> simplify(Segments), Vertices
shift = ShiftList(List=explode.Segments, Shift=1, Wrap=True)  # -> simplify(List)
end = EndPoints(Curve=explode.Segments)  # -> Start, End
angle = Angle(VectorA=explode.Segments, VectorB=shift)  # -> Angle, Reflex
A = ClusterInput()
smaller = SmallerThan(FirstNumber=A, SecondNumber=angle.Angle)  # -> SmallerThan, OrEqualTo
cull = CullPattern(List=end.End, CullPattern=smaller.SmallerThan)  # -> flatten(List)
L = ClusterOutput(cull)
