# Grasshopper definition 2-1.gh (Grasshopper 0.9.76)
# plug-ins: Python Interpreter

高さ = Slider(4000, range=0..10000)
スパン = Slider(6000, range=0..10000)
奥行 = Slider(150, range=0..1000)
分割数 = Slider(20, range=0..30)
角度 = Slider(0, range=0..90)
厚み = Slider(10, range=0..10)

# ----
# 2
xz = XZPlane(Origin=Point(0, 0, 0))
yz = YZPlane(Origin=Point(0, 0, 0))
planesrf = PlaneSurface(Plane=xz, XSize=スパン, YSize=高さ)
planesrf_2 = PlaneSurface(Plane=yz, XSize=スパン, YSize=高さ)
planesrf_3 = PlaneSurface(Plane=PlaneXY(0, 0, 0), XSize=スパン, YSize=スパン)
Y = UnitY(Factor=スパン)
X = UnitX(Factor=スパン)
Z = UnitZ(Factor=高さ)
move = Move(Geometry=planesrf, Motion=Y)  # -> Geometry, Transform
move_2 = Move(Geometry=planesrf_2, Motion=X)  # -> Geometry, Transform
move_3 = Move(Geometry=planesrf_3, Motion=Z)  # -> Geometry, Transform

# ----
# 1
panel = Panel("0")
neg = Negative(Value=奥行)
pt = ConstructPoint(XCoordinate=panel, YCoordinate=panel, ZCoordinate=高さ)
pt_2 = Point(Point(0, 0, 0))
dom = ConstructDomain(DomainStart=neg, DomainEnd="0")
ln = Line(StartPoint=pt_2, EndPoint=pt)
divide = DivideCurve(Curve=ln, Count=分割数, Kinks=False)  # -> Points, Tangents, Parameters
# 3
pi = Pi(Factor=1)
planesrf_4 = PlaneSurface(Plane=divide.Points, XSize=スパン, YSize=dom)
division = Division(A=角度, B="180")
Z_2 = UnitZ(Factor=厚み)
multiplication = Multiplication(A=division, B=pi)
X_2 = UnitX(Factor=1)
extr = Extrude(Base=planesrf_4, Direction=Z_2)
rot3d = Rotate3D(Geometry=extr, Angle=multiplication, Center=divide.Points, Axis=X_2)  # -> Geometry, Transform

# ---- group: 3-3
toggle = BooleanToggle(False)
toggle_2 = BooleanToggle(True)

# ---- group: 3-2
回転角 = Slider(0, range=0..360)
月 = Slider(12, range=0..12)
太陽スケール = Slider(2, range=0..10)
最低値 = Slider(0, range=0..100)
日 = Slider(22, range=0..31)
開始時刻 = Slider(8, range=0..10)
時間数 = Slider(10, range=0..15)
パススケール = Slider(0.045, range=0..1)
投影タイプ = Slider(0, range=0..2)
グリッドサイズ = Slider(20, range=0..100)
高さ_2 = Slider(0.1, range=0..1)
最高値 = Slider(8, range=0..24)

# ---- group: 3-1
ladybug = Ladybug_Ladybug()  # -> Vviiiiiiiiiizzz; plug-in component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

# ---- group: 3-3
open_weather_file = Ladybug_OpenEPWWeatherFile(open=toggle)  # -> epwFile; plug-in component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
importlocation = Ladybug_ImportLocation(epwFile=open_weather_file)  # -> location; plug-in component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

# ---- group: 3-2
series = Series(Start=開始時刻, Step=1, Count=時間数)
division_2 = Division(A=スパン, B=2)
pt_3 = ConstructPoint(XCoordinate=division_2, YCoordinate=0, ZCoordinate=0)

# ---- group: 3-4
sunpath = Ladybug_SunPath(
    north=回転角,
    location=importlocation,
    hour=series,
    day=日,
    month=月,
    timeStep=1,
    centerPt=pt_3,
    sunPathScale=パススケール,
    sunScale=太陽スケール,
    projection=投影タイプ,
    dailyOrAnnualSunPath=True)  # -> readMe, sunVectors, sunAltitudes, sunAzimuths, port, sunSpheresMesh, sunPathCrvs, compassCrvs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; plug-in component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

# ---- group: 3-5
merge = Merge(Data1=extr, Data2=move.Geometry, Data3=planesrf_2, Data4=move_2.Geometry, Data5=move_3.Geometry)
wires = BrepWireframe(Brep=merge, Density=-1)

# ---- group: 3-6
range = Range(Domain=Domain(0, 1), Steps=10)
gradient = Gradient(LowerLimit=0, UpperLimit=1, Parameter=reverse(range), stops=[0: RGB(255, 255, 255), 1: RGB(0, 0, 0)])
legendpar = Ladybug_LegendParameters(lowBound=最低値, highBound=最高値, customColors=flatten(gradient))  # -> legendPar; plug-in component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
sunlighthoursanalysis = Ladybug_SunlightHoursAnalysis(
    geometry=flatten(planesrf_3),
    context=flatten(merge),
    gridSize=グリッドサイズ,
    disFromBase=高さ_2,
    sunVectors=flatten(sunpath.sunVectors),
    timeStep=1,
    legendPar=flatten(legendpar),
    runIt=toggle_2)  # -> readMe, contextMesh, analysisMesh, testPts, testVec, port, sunlightHoursResult, sunlightHoursMesh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; plug-in component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
mesh = Mesh(sunlighthoursanalysis.sunlightHoursMesh)
