# Grasshopper definition 2-2.gh (Grasshopper 0.9.76)
# plug-ins: Python Interpreter

高さ = Slider(4000, range=0..10000)
スパン = Slider(6000, range=0..10000)
奥行 = Slider(150, range=0..1000)
分割数 = Slider(20, range=0..30)
角度 = Slider(0, range=0..90)
厚み = Slider(10, range=0..10)

# ----
# 2
xz = XZPlane(Origin=Point(0, 0, 0))
yz = YZPlane(Origin=Point(0, 0, 0))
planesrf = PlaneSurface(Plane=xz, XSize=スパン, YSize=高さ)
planesrf_2 = PlaneSurface(Plane=yz, XSize=スパン, YSize=高さ)
planesrf_3 = PlaneSurface(Plane=PlaneXY(0, 0, 0), XSize=スパン, YSize=スパン)
Y = UnitY(Factor=スパン)
X = UnitX(Factor=スパン)
Z = UnitZ(Factor=高さ)
move = Move(Geometry=planesrf, Motion=Y)  # -> Geometry, Transform
move_2 = Move(Geometry=planesrf_2, Motion=X)  # -> Geometry, Transform
move_3 = Move(Geometry=planesrf_3, Motion=Z)  # -> Geometry, Transform

# ----
# 1
panel = Panel("0")
neg = Negative(Value=奥行)
pt = ConstructPoint(XCoordinate=panel, YCoordinate=panel, ZCoordinate=高さ)
pt_2 = Point(Point(0, 0, 0))
dom = ConstructDomain(DomainStart=neg, DomainEnd="0")
ln = Line(StartPoint=pt_2, EndPoint=pt)
divide = DivideCurve(Curve=ln, Count=分割数, Kinks=False)  # -> Points, Tangents, Parameters
pi = Pi(Factor=1)
planesrf_4 = PlaneSurface(Plane=divide.Points, XSize=スパン, YSize=dom)
division = Division(A=角度, B="180")
Z_2 = UnitZ(Factor=厚み)
multiplication = Multiplication(A=division, B=pi)
X_2 = UnitX(Factor=1)
extr = Extrude(Base=planesrf_4, Direction=Z_2)
rot3d = Rotate3D(Geometry=extr, Angle=multiplication, Center=divide.Points, Axis=X_2)  # -> Geometry, Transform

回転角 = Slider(0, range=0..360)
月 = Slider(10, range=0..12)
太陽スケール = Slider(2, range=0..10)
日 = Slider(22, range=0..31)
開始時刻 = Slider(12, range=0..20)
時間数 = Slider(1, range=0..15)
パススケール = Slider(0.045, range=0..1)
投影タイプ = Slider(0, range=0..2)

# ----
# 3
ladybug = Ladybug_Ladybug()  # -> Vviiiiiiiiiizzz; plug-in component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
open_weather_file = Ladybug_OpenEPWWeatherFile(open=Toggle(False))  # -> epwFile; plug-in component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
series = Series(Start=開始時刻, Step=1, Count=時間数)
importlocation = Ladybug_ImportLocation(epwFile=open_weather_file)  # -> location; plug-in component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
division_2 = Division(A=スパン, B=2)
pt_3 = ConstructPoint(XCoordinate=division_2, YCoordinate=0, ZCoordinate=0)
sunpath = Ladybug_SunPath(
    north=回転角,
    location=importlocation,
    hour=series,
    day=日,
    month=月,
    timeStep=1,
    centerPt=pt_3,
    sunPathScale=パススケール,
    sunScale=太陽スケール,
    projection=投影タイプ,
    dailyOrAnnualSunPath=True)  # -> readMe, sunVectors, sunAltitudes, sunAzimuths, port, sunSpheresMesh, sunPathCrvs, compassCrvs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; plug-in component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

# ---- group: 3-1
基点数 = Slider(8, range=0..10)
反射回数 = Slider(2, range=0..10)

# ----
merge = Merge(Data1=extr, Data2=move.Geometry, Data3=planesrf_2, Data4=move_2.Geometry, Data5=move_3.Geometry, Data6=planesrf_3)

# ---- group: 3-1
neg_2 = Negative(Value=奥行)
Y_2 = UnitY(Factor=neg_2)
move_4 = Move(Geometry=planesrf, Motion=Y_2)  # -> Geometry, Transform
sdivide = DivideSurface(Surface=move_4.Geometry, UCount=基点数, VCount=基点数)  # -> Points, Normals, Parameters
forwardraytracing = Ladybug_ForwardRaytracing(
    startPts=sdivide.Points,
    startVectors=graft(sunpath.sunVectors),
    context=flatten(merge),
    numOfBounce=反射回数,
    lastBounceLen=4)  # -> rays; plug-in component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
preview = CustomPreview(Geometry=forwardraytracing, Shader=ColourSwatch(SwatchColor=RGB(255, 255, 0)))
