# Grasshopper definition 2-3.gh (Grasshopper 0.9.76)
# plug-ins: Python Interpreter

# ---- group: 2-2
toggle = BooleanToggle(False)
toggle_2 = BooleanToggle(False)
グリッドサイズ = Slider(2, range=0..50)
toggle_3 = BooleanToggle(False)
高さ = Slider(0.1, range=0..1)

# ---- group: 1-1
# 1
節点数 = Slider(7, range=0..10)
ランダム性 = Slider(5, range=0..10)
領域 = Slider(200, range=0..100000)
建物サイズ = Slider(50, range=0..10000)
# 2
建物選択 = Slider(4, range=0..10)
高さ_2 = Slider(100, range=0..100)

# ---- group: 2-1
ladybug = Ladybug_Ladybug()  # -> Vviiiiiiiiiizzz; plug-in component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

# ---- group: 2-3
open_weather_file = Ladybug_OpenEPWWeatherFile(open=toggle)  # -> epwFile; plug-in component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
gencumulativeskymtx = Ladybug_GenCumulativeSkyMtx(epwFile=open_weather_file, skyDensity=0, useOldRes=True, runIt=toggle_2)  # -> readMe, cumulativeSkyMtx; plug-in component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
selectskymtx = Ladybug_selectSkyMtx(cumulativeSkyMtx=gencumulativeskymtx.cumulativeSkyMtx, removeDiffuse=False, removeDirect=False)  # -> readMe, selectedSkyMtx; plug-in component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

# ---- group: 1-1
rectangle = Rectangle(Plane=PlaneXY(0, 0, 0), XSize=領域, YSize=領域, Radius=0)  # -> Rectangle, Length
pop2d = Populate2D(Region=rectangle.Rectangle, Count=節点数, Seed=ランダム性)

# ---- group: 1-2
rectangle_2 = Rectangle(Plane=pop2d, XSize=建物サイズ, YSize=建物サイズ, Radius=0)  # -> Rectangle, Length
Z = UnitZ(Factor=高さ_2)
extr = Extrude(Base=rectangle_2.Rectangle, Direction=Z)
cap = CapHoles(Brep=extr)

# ---- group: 1-3
wires = BrepWireframe(Brep=cap, Density=-1)
cull_i = CullIndex(List=cap, Indices=建物選択, Wrap=True)
item = ListItem(List=cap, Index=建物選択, Wrap=True)

# ---- group: 2-4
radiationanalysis = Ladybug_RadiationAnalysis(
    geometry=flatten(item),
    context=flatten(cull_i),
    gridSize=グリッドサイズ,
    disFromBase=高さ,
    selectedSkyMtx=flatten(selectskymtx.selectedSkyMtx),
    parallel=toggle_3,
    runIt=toggle_3)  # -> readMe, contextMesh, analysisMesh, testPts, testVec, port, radiationResult, radiationMesh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; plug-in component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
