# Grasshopper definition 3-1.gh (Grasshopper 0.9.76)
# plug-ins: Karamba

# ---- group: 1-1
# 1
x座標 = Slider(5, range=0.1..10)
斜材取付位置 = Slider(0.72, range=0.001..1)

pt = ConstructPoint(XCoordinate=x座標, YCoordinate="0", ZCoordinate="0")
pt_2 = Point(Point(0, 0, 1))
pt_3 = Point(Point(0, 0, 0))

# ---- group: 1-2
ln = Line(StartPoint=pt_3, EndPoint=pt)
len = Length(Curve=ln)
remap = RemapNumbers(Value=斜材取付位置, Source=Domain(0, 1), Target=len)  # -> Mapped, Clipped
eval = EvaluateLength(Curve=ln, Length=remap.Mapped, Normalized=Toggle(False))  # -> Point, Tangent, Parameter

# ---- group: 1-3
ln_2 = Line(StartPoint=pt_2, EndPoint=eval.Point)
ln_3 = Line(StartPoint=pt_3, EndPoint=eval.Point)
ln_4 = Line(StartPoint=eval.Point, EndPoint=pt)
merge = Merge(Data1=ln_3, Data2=ln_4)

# ---- group: 2-1
# 2
panel = Panel("A")
panel_2 = Panel("B")

# ---- group: 2-4
直径_cm = Slider(6.05, range=0..10)
厚み_cm = Slider(0.32, range=0..3)

# 断面
panel_3 = Panel("20")
crossecs = CrossSectionsKaramba(
    ElementsIdentifiers=panel_2,
    Height_cm=9.6,
    UpperFlangeWidth_cm=panel_3,
    LowerFlangeWidth_cm=panel_3,
    UpperFlangeThickness_cm=0.8,
    LowerFlangeThickness_cm=0.8,
    WebThickness_cm=0.5,
    FilletRadius_cm=0,
    mode="I")
crosecrselect = CrossSectionRangeSelectorKaramba(MaximumHeight_cm=-1, MaximumWidth_cm=-1, menu=[dropdown(5), dropdown(1), dropdown(1)])
panel_4 = Panel(crosecrselect)
cross_sections = CrossSectionsKaramba(ElementsIdentifiers=panel, NameOfCrossSection=panel, Diameter_cm=直径_cm, WallThickness_cm=厚み_cm, mode="Circular Hollow")
csmatch = CrossSectionMatcherKaramba(MatchCrossSection=crossecs, CrossSections=crosecrselect)  # -> CrossSection, Info
panel_5 = Panel(csmatch.CrossSection)
crosec = CrossSectionKaramba(flatten([cross_sections, csmatch.CrossSection]))

# ---- group: 2-3
# 荷重
panel_6 = Panel("-6")
Z = UnitZ(Factor=panel_6)
loads = LoadsKaramba(Vector=Z, BeamIdentifierS=panel_2, LCase=0, mode="Uniform Line", menu=[buttons(off, on, off)])

# ---- group: 2-1
# 要素
linetobeam = LineToBeamKaramba(Line=ln_2, New=True, Remove=True, LimitDistance_m=0.005, BeamIdentifier=panel)  # -> Points, Element, Info
modifyelem = ModifyElementKaramba(Beam=linetobeam.Element, Bending=Toggle(False), mode="Beam")
linetobeam_2 = LineToBeamKaramba(Line=merge, New=True, Remove=True, LimitDistance_m=0.005, BeamIdentifier=panel_2)  # -> Points, Element, Info
element = ElementKaramba([modifyelem, linetobeam_2.Element])

# ---- group: 2-2
# 支点
supp = SupportKaramba(PosInd=[pt_2, pt_3], menu=[buttons(on, on, on, on, off, on)])

# ---- group: 2-5
# 材料
matselect = MaterialSelectionKaramba(menu=[dropdown(1), dropdown(2)])

# ---- group: 2-6
assemble = AssembleModelKaramba(Elem=element, Support=supp, Load=loads, CrossSection=crosec, Material=matselect, LimitDistance_m=0.005)  # -> Model, Info, Mass_kg, CenterOfGravity
analyzethi = AnalyzeThIKaramba(Model=assemble.Model)  # -> CalculatedModel, MaximumDisplacement_m, ResultingForceOfGravity_kN, ElasticEnergy_kNm

# ---- group: 2-7
modelview = ModelViewKaramba(Model=analyzethi.CalculatedModel, LoadCaseFactorsForLinearSuperposition=1, IndexIncrementOfVisibleLoadcase=0)  # -> Model, DeformedMesh, DeformedAxes, DeformedModel
multiplication = Multiplication(A=analyzethi.MaximumDisplacement_m, B=1000)
division = Division(A=x座標, B=analyzethi.MaximumDisplacement_m)
変形_mm = Panel(multiplication)
変形角 = Panel(division)
beamview = BeamViewKaramba(Model=modelview.Model)  # -> Model, MeshesOfRenderedBeams, DeformedBeamAxes, LegendColors, LegendTags
legend = Legend(Colour=beamview.LegendColors, Tags=beamview.LegendTags, LegendType=101)

# ----
# 3
galapagos = Galapagos(fitness=num, gene=斜材取付位置)
num = Number(analyzethi.MaximumDisplacement_m)
