# Grasshopper definition 4-1.gh (Grasshopper 0.9.76)
# plug-ins: gHowl

# ---- group: 2-1
# 2
panel = Panel("127.0.0.1")
panel_2 = Panel("7000")
panel_3 = Panel("999")
panel_4 = Panel("0")

# ---- group: 1-1
# 1
幅_mm = Slider(200, range=0..1000)
枚数 = Slider(20, range=0..100)
スパン_mm = Slider(6000, range=0..10000)

# ---- group: 2-1
udp = UDPReceiver(Address=panel, Port=panel_2, Pattern=panel_3)  # -> Info, Data

# ---- group: 1-1
series = Series(Start=0, Step=幅_mm, Count=枚数)
Z = UnitZ(Factor=series)
pt = Point(Point(0, 0, 0))
move = Move(Geometry=pt, Motion=Z)  # -> Geometry, Transform

# ---- group: 2-2
倍率 = Slider(40000, range=0..50000)
cull_i = CullIndex(List=udp.Data, Indices=panel_4, Wrap=True)
multiplication = Multiplication(A=cull_i, B=倍率)
num = Number(cull_i)

# ---- group: 1-2
X = UnitX(Factor=スパン_mm)
division = Division(A=スパン_mm, B=2)
move_2 = Move(Geometry=move.Geometry, Motion=X)  # -> Geometry, Transform
X_2 = UnitX(Factor=division)
move_3 = Move(Geometry=move.Geometry, Motion=X_2)  # -> Geometry, Transform
ln = Line(StartPoint=move.Geometry, EndPoint=move_2.Geometry)  # -> graft(Line)
pdecon = Deconstruct(Point=move_3.Geometry)  # -> XComponent, YComponent, ZComponent
expression = Expression(x=pdecon.ZComponent, y=幅_mm, z=枚数, u=num, v=multiplication, Expression="v-(x-(y*z/2))²*u/100")
pt_2 = ConstructPoint(XCoordinate=pdecon.XComponent, YCoordinate=expression, ZCoordinate=pdecon.ZComponent)

# ---- group: 1-3
merge = Merge(Data1=graft(move.Geometry), Data2=graft(pt_2), Data3=graft(move_2.Geometry))
nurbs = NurbsCurve(Vertices=merge, Degree=Slider(2, range=0..10), Periodic=False)  # -> Curve, Length, Domain
loft = Loft(
    Curves=[ln, nurbs.Curve],
    Options={Adjust=False, Closed=False, LoftEnds=0, LoftSimp=0, LoftType=0, Rebuild=10, Refit=0.01})
