# Grasshopper definition 4-1.gh (Grasshopper 0.9.76)
# plug-ins: gHowl

# ----
# IPアドレス
panel = Panel("000.000.000.0")

# ----
# 1
udp = UDPReceiver(Address=panel, Port="7000", Pattern="999")  # -> Info, Data
osc_d = OSCDispatch(OSCDevices="/S1", OSCMessage=udp.Data)  # -> OSCDevice, OSCData
osc_d_2 = OSCDispatch(OSCDevices="/S2", OSCMessage=udp.Data)  # -> OSCDevice, OSCData
osc_d_3 = OSCDispatch(OSCDevices="/S1-", OSCMessage=udp.Data)  # -> OSCDevice, OSCData
osc_d_4 = OSCDispatch(OSCDevices="/S5", OSCMessage=udp.Data)  # -> OSCDevice, OSCData
osc_d_5 = OSCDispatch(OSCDevices="/S7", OSCMessage=udp.Data)  # -> OSCDevice, OSCData
osc_d_6 = OSCDispatch(OSCDevices="/S8", OSCMessage=udp.Data)  # -> OSCDevice, OSCData
osc_d_7 = OSCDispatch(OSCDevices="/MDS1", OSCMessage=udp.Data)  # -> OSCDevice, OSCData
panel_2 = Panel(osc_d.OSCData)
panel_3 = Panel(osc_d_4.OSCData)
panel_4 = Panel(osc_d_5.OSCData)
panel_5 = Panel(osc_d_6.OSCData)
panel_6 = Panel(osc_d_2.OSCData)
panel_7 = Panel(osc_d_7.OSCData)
split = TextSplit(Text=osc_d_7.OSCData, Separators=",")
neg = Negative(Value=osc_d_3.OSCData)
panel_8 = Panel(neg)

# ----
# 2
multiplication = Multiplication(A=osc_d_4.OSCData, B=osc_d_5.OSCData)
multiplication_2 = Multiplication(A=split, B=multiplication)
item = ListItem(List=multiplication_2, Index=0, Wrap=True)
item_2 = ListItem(List=multiplication_2, Index=1, Wrap=True)
xz = XZPlane(Origin=Point(0, 0, 0))
sqgrid = Square(Plane=xz, Size=osc_d_5.OSCData, ExtentX=osc_d_4.OSCData, ExtentY=osc_d_4.OSCData)  # -> Cells, Points
pt = ConstructPoint(XCoordinate=item, YCoordinate=0, ZCoordinate=item_2)
vec2pt = Vector2Pt(PointA=sqgrid.Points, PointB=pt, Unitize=False)  # -> Vector, Length
circle = CircleCNR(Center=sqgrid.Points, Normal=vec2pt.Vector, Radius=osc_d_6.OSCData)
frgb = ColourRGBF(Alpha=1, Red=osc_d.OSCData, Green=osc_d_2.OSCData, Blue=neg)
boundary = BoundarySurfaces(Edges=circle)
preview = CustomPreview(Geometry=boundary, Shader=frgb)
