# Grasshopper definition 5-1.gh (Grasshopper 0.9.76)

number_slider = Slider(10, range=0..100)
number_slider_2 = Slider(10, range=0..100)
neg = Negative(Value=number_slider_2)
neg_2 = Negative(Value=number_slider)
division = Division(A=neg, B=2)
division_2 = Division(A=number_slider_2, B=2)
division_3 = Division(A=neg_2, B=2)
division_4 = Division(A=number_slider, B=2)
dom = ConstructDomain(DomainStart=division, DomainEnd=division_2)
dom_2 = ConstructDomain(DomainStart=division_3, DomainEnd=division_4)
rectangle = Rectangle(Plane=PlaneXY(0, 0, 0), XSize=dom, YSize=dom_2, Radius=0)  # -> Rectangle, Length
geo = Geometry(rectangle.Rectangle)
