# Grasshopper definition 5-2.gh (Grasshopper 0.9.76)

pt = Point(Point(0, 100, 100))
pt_2 = Point(Point(0, 0, 0))
ln = Line(StartPoint=pt_2, EndPoint=pt)
len = Length(Curve=ln)
remap = RemapNumbers(Value=Slider(0.5, range=0..1), Source=Domain(0, 1), Target=len)  # -> Mapped, Clipped
eval = EvaluateLength(Curve=ln, Length=remap.Mapped, Normalized=Toggle(False))  # -> Point, Tangent, Parameter
pframe = PerpFrame(Curve=ln, Parameter=eval.Parameter)
deplane = DeconstructPlane(Plane=pframe)  # -> Origin, XAxis, YAxis, ZAxis
line = LineSDL(Start=deplane.Origin, Direction=deplane.YAxis, Length=Slider(100, range=0..1000))
