# Grasshopper definition 5-4.gh (Grasshopper 0.9.76)

pop3d = Populate3D(
    Region={Plane=PlaneXY(0, 0, 0), X=Domain(0, 10), Y=Domain(0, 10), Z=Domain(0, 2)},
    Count=Slider(10, range=0..100),
    Seed=1)
pt = Point(pop3d)
sort_pt = SortPoints(Points=pt)  # -> Points, Indices
pdecon = Deconstruct(Point=pt)  # -> XComponent, YComponent, ZComponent

order = PointOrder(Points=sort_pt.Points)
points = PointList(Points=sort_pt.Points, Size=Slider(1, range=0..10))

pt_2 = ConstructPoint(XCoordinate=pdecon.YComponent, YCoordinate=pdecon.XComponent, ZCoordinate=pdecon.ZComponent)
sort_pt_2 = SortPoints(Points=pt_2)  # -> Points, Indices
pdecon_2 = Deconstruct(Point=sort_pt_2.Points)  # -> XComponent, YComponent, ZComponent
pt_3 = ConstructPoint(XCoordinate=pdecon_2.YComponent, YCoordinate=pdecon_2.XComponent, ZCoordinate=pdecon_2.ZComponent)

points_2 = PointList(Points=pt_3, Size=Slider(2, range=0..10))
order_2 = PointOrder(Points=pt_3)
